% Simulink data dictionary AION_IDS.sldd
% references Model_Config.sldd
% references Common_Definition.sldd

ADCU2SCU_ADCU_1 = Simulink.Bus()
  ADCU_1_Checksum: double, Min=0, Max=255  % Message checksum
  ADCU_1_MsgCounter: double, Min=0, Max=15  % Message counter of ADCU_1
  ADCU_AutoTrqWhlReq: double, Min=-5000, Max=5000, Unit="Nm"  % Automatic driving driving torque
    % request: only active in automatic
    % driving mode
  ADCU_BrakeReq: double, Min=-16, Max=16, Unit="m/s^2"  % Brake request signal: only active in automatic driving mode.
  ADCU_GearLvlReq: double, Min=0, Max=7  % Gear lever position request for the vehicle motion control. When the demand Gear is P, the vehicle will apply EPB automatically.
  ADCU_GearLvlReqVD: double, Min=0, Max=1  % Enable flag to control the gear box
  ADCU_LngCtrlReq: double, Min=0, Max=3  % Longitudinal control request
  ADCU_ParkingReqToEPB: double, Min=0, Max=1  % Release brake request to EPB.
  ADCU_ParkingReqToEPBVD: double, Min=0, Max=1  % SCU request EPB function
    % valid data

ADCU2SCU_ADCU_2 = Simulink.Bus()
  ADCU_2_Checksum: double, Min=0, Max=255  % Message checksum
  ADCU_2_MsgCounter: double, Min=0, Max=15  % Message counter of ADCU_2
  ADCU_LatCtrlReq: double, Min=0, Max=1, Unit="-"  % EPS on request
  ADCU_SteerAngReq: double, Min=-780, Max=779.9, Unit="deg"  % The request steering wheel angle to EPS (turn left+ turn right-): only
    % active in automatic driving mode. This is not available now.
  ADCU_SteerAngSpdLimt: double, Min=0, Max=1080, Unit="deg/s"  % Limitation of steering angular speed， EPS will not let the angular speed of steering wheel be over this limitation: only active in automatic driving mode
  ADCU_SteerWhlTorqReq: double, Min=-10.24, Max=10.23, Unit="Nm"  % Demand torque of steering wheel((turn left+ turn right-))

ADCU2SCU_ADCU_3 = Simulink.Bus()
  ADCU_3_Checksum: double, Min=0, Max=255, Unit="-"  % Message checksum
  ADCU_3_MsgCounter: double, Min=0, Max=15, Unit="-"  % Message counter of ADCU_3
  ADCU_BeamReq: double, Min=0, Max=3, Unit="-"  % Low / High beam control request
  ADCU_BodyCtrlReq: double, Min=0, Max=1, Unit="-"  % Enable vehicle body control
  ADCU_HornRingReq: double, Min=0, Max=1, Unit="-"  % Horn control request
  ADCU_TurnLightReq: double, Min=0, Max=3, Unit="-"  % Turn light control request

SCU2ADCU_SCU_1 = Simulink.Bus()
  BCS_ABSActiveSt: double, Min=0, Max=1, Unit="-"  % Indication that ABS system currently performs a brake intervention
  BCS_ABSFaultSt: double, Min=0, Max=1, Unit="-"  % ABS system has detected a failure which does no allow a reliable ABS regulation and is therefore switched off
  BCS_VDCActiveSt: double, Min=0, Max=1, Unit="-"  % Indication that VDC system currently performs a brake/engine intervention
  BCS_VDCFaultSt: double, Min=0, Max=1, Unit="-"  % VDC is switched off due to detected failure
  BCS_VehSpd: double, Min=0, Max=240, Unit="km/h"  % Vehicle speed
  BCS_VehSpdVD: double, Min=0, Max=1, Unit="-"  % Quality/fault information to vehicle speed
  SCU_1_Checksum: double, Min=0, Max=255, Unit="-"
  SCU_1_MsgCounter: double, Min=0, Max=15, Unit="-"  % The MessageCounter is a 0 ~ 15 counter, increased of one unit on every message transmission

SCU2ADCU_SCU_10 = Simulink.Bus()
  EPS_SteeringAngle: double, Min=-780, Max=779.9, Unit="deg"  % Steering wheel angle
  EPS_SteeringAngleSpd: double, Min=0, Max=1016, Unit="deg/sec"  % steering wheel angle speed
  EPS_SteeringAngleSpdVD: double, Min=0, Max=1  % Steering wheel angle speed valid value
  EPS_SteeringAngleVD: double, Min=0, Max=1  % Steering wheel angle valid value
  EPS_StrngWhlTorq: double, Min=-12.5, Max=12.5, Unit="Nm"  % Steering wheel Torque
  EPS_StrngWhlTorqVD: double, Min=0, Max=1  % Steering Wheel Torque valid value
  EPS_ThermalSt: double, Min=0, Max=3  % System Thermal status
  EPS_WarnLamp: double, Min=0, Max=1  % Steering Warning Lamp
  SCU_10_Checksum: double, Min=0, Max=255  % Message checksum
  SCU_10_MsgCounter: double, Min=0, Max=15  % Check the MessageCounter consistency atleast on every message reception

SCU2ADCU_SCU_11 = Simulink.Bus()
  BCM_CtrlAvailable: double, Min=0, Max=1  % Body control is available
  BCM_DriverDoorAjarSt: double, Min=0, Max=1  % Driver door ajar status
  BCM_FrontFogLampSt: double, Min=0, Max=1  % Front fog lamp status
  BCM_FrontWiperSt: double, Min=0, Max=3  % Front wiper status
  BCM_HazardLampSt: double, Min=0, Max=1  % Hazard lamp status
  BCM_HighBeamSt: double, Min=0, Max=1  % High beam status
  BCM_HornSt: double, Min=0, Max=1  % Horn status
  BCM_KeySt: double, Min=0, Max=3  % Ignition key position status
  BCM_LeftTurnLampFaultSt: double, Min=0, Max=1  % Left turn lamp fault status
  BCM_LeftTurnLampSt: double, Min=0, Max=1  % Left turn lamp status
  BCM_LowBeamSt: double, Min=0, Max=1  % Low beam status
  BCM_PsngrDoorAjarSt: double, Min=0, Max=1  % Passenger door ajar status
  BCM_RLDoorAjarSt: double, Min=0, Max=1  % Rear left door ajar status
  BCM_RRDoorAjarSt: double, Min=0, Max=1  % Rear right door ajar status
  BCM_RearFogLampSt: double, Min=0, Max=1  % Rear fog lamp status
  BCM_RightTurnLampFaultSt: double, Min=0, Max=1  % Right turn lamp fault status
  BCM_RightTurnLampSt: double, Min=0, Max=1  % Right turn lamp status
  SCU_11_Checksum: double, Min=0, Max=255
  SCU_11_MsgCounter: double, Min=0, Max=15  % Message counter

SCU2ADCU_SCU_12 = Simulink.Bus()
  SCU_12_Checksum: double, Min=0, Max=255  % Message checksum
  SCU_12_MsgCounter: double, Min=0, Max=15  % The message counter is a 0-15 counter, increased of one unit on every message transmission
  SRS_DriverSeatBeltSt: double, Min=0, Max=3  % To identify whether Driver Seat Belt is buckled
  SRS_PsngrSeatBeltSt: double, Min=0, Max=3  % To identify whether Passenger Seat Belt is buckled

SCU2ADCU_SCU_13 = Simulink.Bus()
  SCU_13_Checksum: double, Min=0, Max=255  % Message checksum
  SCU_13_MsgCounter: double, Min=0, Max=15  % The message counter is a 0-15 counter, increased of one unit on every message transmission
  SCU_EStopSwSt: double, Min=0, Max=1  % Emergency switch status
  SCU_EStopSwStVD: double, Min=0, Max=1  % Emergency switch status validity
  SCU_LatAutoCheckReport: double, Min=0, Max=15  % Check report for Lateral control request(MANUAL->AUTO)
  SCU_LatCtrlMode: double, Min=0, Max=3  % Lateral control mode
  SCU_LatQuitReport: double, Min=0, Max=255  % Lateral control quit report(Auto->Quit).
  SCU_LngAutoChecklReport: double, Min=0, Max=65535  % Check report for Longitudinal control request(MANUAL->AUTO).
  SCU_LngCtrlMode: double, Min=0, Max=3  % Longitudinal control mode
  SCU_LngQuitReport: double, Min=0, Max=65535  % Longitudinal control quit report(Auto->Quit).
  SCU_StrngWhlIntv: double, Min=0, Max=1  % Steering wheel intervention
  VCU_GearLeverIntv: double, Min=0, Max=1  % Gear intervention

SCU2ADCU_SCU_14 = Simulink.Bus()
  VCU_VehDrvMod: double, Min=0, Max=7, Unit="-"  % Drive mode for display
  VCU_VehRdySt: double, Min=0, Max=1, Unit="-"  % HEV system ready status
  VCU_VehRng: double, Min=0, Max=1000, Unit="km"  % Total range for display

SCU2ADCU_SCU_15 = Simulink.Bus()
  VCU_ActRecpTorq: double, Min=0, Max=2000, Unit="Nm"  % Current recuperation torque of generator
  VCU_ActRecpTorqSt: double, Min=0, Max=3  % Status of recuperation torque of generator
  VCU_CrntGearLvl: double, Min=0, Max=7  % VCU current carry out gear level
  VCU_CrntGearLvlVD: double, Min=0, Max=1  % VCU current carry out gear level valid data

SCU2ADCU_SCU_16 = Simulink.Bus()
  SCU_16_Checksum: double, Min=0, Max=205, Unit="-"  % Message checksum
  SCU_16_MsgCounter: double, Min=0, Max=15, Unit="-"  % The MessageCounter is a 0 ~ 15 counter, increased of one unit on every message transmission
  VCU_ACCMaxRecpDecel: double, Min=-5, Max=7.75, Unit="m/s2"  % Current maximum recuperation deceleration of generator
  VCU_ACCMaxRecpDecelVD: double, Min=0, Max=1  % VCU_ACCMaxRecpDecel valid validity
  VCU_ActVehWheelTorq: double, Min=0, Max=10000, Unit="Nm"  % Actual effective engine torque on wheel level
  VCU_LateralAssistBtnInfo: double, Min=0, Max=1  % Lateral assist button Information
  VCU_LateralAssistBtnInfoVD: double, Min=0, Max=1  % Lateral assist button Information valid data

SCU2ADCU_SCU_17 = Simulink.Bus()
  SCU_17_Checksum: double, Min=0, Max=255, Unit="-"  % Checksum signal for frame
  SCU_17_MsgCounter: double, Min=0, Max=15, Unit="-"  % Message counter signal for frame
  VCU_ACCButtInfo: double, Min=0, Max=255  % ACC Button Information
  VCU_AccElecECFail: double, Min=0, Max=1, Unit="-"  % Indicate the error state of electronic engine control.
  VCU_GasPedalActPst: double, Min=0, Max=99.96, Unit="%"  % Actual position of gas pedal.
  VCU_GasPedalActPstVD: double, Min=0, Max=1  % Actual position of gas pedal validity.
  VCU_VehWheelTorqMax: double, Min=0, Max=10000, Unit="Nm"  % Actual effective maximum adjustable torque on wheel level

SCU2ADCU_SCU_18 = Simulink.Bus()
  SCU_18_Checksum: double, Min=0, Max=255, Unit="-"  % Checksum signal for frame
  SCU_18_MsgCounter: double, Min=0, Max=15, Unit="-"  % Message counter signal for frame
  VCU_BrkPedalSt: double, Min=0, Max=1  % Brake pedal status
  VCU_BrkPedalStVD: double, Min=0, Max=1  % VCU_BrakePedSt valid data
  VCU_GasPedalVirtualPst: double, Min=0, Max=99.96, Unit="%"  % Virtual position of gas pedal position.
  VCU_GasPedalVirtualPstVD: double, Min=0, Max=1  % Virtual position of gas pedal position validity.

SCU2ADCU_SCU_2 = Simulink.Bus()
  BCS_FLWheelSpdEdgesSum: double, Min=0, Max=4095  % Accumulated sum of rising and falling edges of front left wheel speed sensor output·since IGN ON( the wheel plate have 43 teeth/cycle,the edge is 86)
  BCS_FLWheelSpdEdgesSumVD: double, Min=0, Max=1  % Quality/fault information to current wheel speed edges sum of front left wheel
  BCS_FRWheelSpdEdgesSum: double, Min=0, Max=4095  % Accumulated sum of rising and falling edges of front right wheel speed sensor output·since IGN ON( the wheel plate have 43 teeth/cycle,the edge is 86)
  BCS_FRWheelSpdEdgesSumVD: double, Min=0, Max=1  % Quality/fault information to current wheel speed edges sum of front right wheel
  BCS_RLWheelSpdEdgesSum: double, Min=0, Max=4095  % Accumulated sum of rising and falling edges of rear left wheel speed sensor output·since IGN ON( the wheel plate have 43teeth/cycle,the edge is 86)
  BCS_RLWheelSpdEdgesSumVD: double, Min=0, Max=1  % Quality/fault information to current wheel speed edges sum of rear left wheel
  BCS_RRWheelSpdEdgesSum: double, Min=0, Max=4095  % Accumulated sum of rising and falling edges of  rear right wheel speed sensor output·since IGN ON( the wheel plate have 43 teeth/cycle,the edge is 86)
  BCS_RRWheelSpdEdgesSumVD: double, Min=0, Max=1  % Quality/fault information to current wheel speed edges sum of rear right wheel
  SCU_2_Checksum: double, Min=0, Max=255
  SCU_2_MsgCounter: double, Min=0, Max=15  % The message counter is a 0-15 counter, increased of one unit on every message transmission

SCU2ADCU_SCU_3 = Simulink.Bus()
  BCS_YawRate: double, Min=-2.0943, Max=1.9047234375, Unit="rad/s"  % Yaw rate
  BCS_YawRateOffset: double, Min=-0.13, Max=0.13, Unit="rad/s"  % Yaw rate offset
  BCS_YawRateSt: double, Min=0, Max=1  % Yaw rate status
  SCU_3_Checksum: double, Min=0, Max=255  % Message checksum
  SCU_3_MsgCounter: double, Min=0, Max=15

SCU2ADCU_SCU_4 = Simulink.Bus()
  BCS_HDCCtrlSt: double, Min=0, Max=3, Unit="-"  % HDC(Hill Descent Control) Control status
  BCS_HDCErrSt: double, Min=0, Max=1, Unit="-"  % HDC error Status
  SCU_4_Checksum: double, Min=0, Max=255, Unit="-"  % Message checksum
  SCU_4_MsgCounter: double, Min=0, Max=15, Unit="-"  % Message counter

SCU2ADCU_SCU_5 = Simulink.Bus()
  BCS_AEBActive: double, Min=0, Max=1  % AEB(Automatic Emergency
    % Braking) is active (in deceleration)
  BCS_AEBAvailable: double, Min=0, Max=1  % AEB(Automatic Emergency
    % Braking) is available
  BCS_CDDActive: double, Min=0, Max=1  % CDD(Controlled Deceleration for Driver) is active
  BCS_CDDAvailable: double, Min=0, Max=1  % CDD(Controlled Deceleration for Driver) is available
  BCS_CDDFail: double, Min=0, Max=1  % CDD in failure
  BCS_MasterCylinderPr: double, Min=0, Max=250, Unit="bar"  % Master cylinder pressure
  BCS_MasterCylinderPrOffset: double, Min=-15, Max=15, Unit="bar"  % Master cylinder pressure offset
  BCS_MasterCylinderPrOffsetVD: double, Min=0, Max=1, Unit="-"  % Master cylinder pressure offset valid value
  BCS_MasterCylinderPrVD: double, Min=0, Max=1, Unit="-"  % The valid value of BCS_MasterCylinderPr
  BCS_NoBrakeForce: double, Min=0, Max=1  % No brake pressure applied,generally it regards wheel cylinder presure
  BCS_VehicleStandStillSt: double, Min=0, Max=3  % Indicating whether the vehicle is standstill or not;
    % must not be set until standstill is surely reached.
  SCU_5_Checksum: double, Min=0, Max=255, Unit="-"
  SCU_5_MsgCounter: double, Min=0, Max=15

SCU2ADCU_SCU_6 = Simulink.Bus()
  BCS_FLWheelRotatedDirection: double, Min=0, Max=1  % FL wheel rotate direction
  BCS_FLWheelRotatedDirectionVD: double, Min=0, Max=1  % FL wheel rotate direction validity
  BCS_FLWheelSpd: double, Min=0, Max=240, Unit="km/h"  % Current wheel speed information of front left wheel
  BCS_FLWheelSpdVD: double, Min=0, Max=1  % Quality/fault information to current wheel speed of front left wheel,be used for validity of BCS_FLWheelSpd and BCS_FLWheelSpdEdgesSum signal
  BCS_FRWheelRotatedDirection: double, Min=0, Max=1  % FR wheel rotate direction
  BCS_FRWheelRotatedDirectionVD: double, Min=0, Max=1  % FR wheel rotate direction validity
  BCS_FRWheelSpd: double, Min=0, Max=240, Unit="km/h"  % Current wheel speed information of front right wheel
  BCS_FRWheelSpdVD: double, Min=0, Max=1  % Quality/fault information to current wheel speed of front left wheel,be used for validity of BCS_FRWheelSpd and BCS_FRWheelSpdEdgesSum signal
  SCU_6_Checksum: double, Min=0, Max=255
  SCU_6_MsgCounter: double, Min=0, Max=15  % The message counter is a 0-15 counter, increased of one unit on every message transmission

SCU2ADCU_SCU_7 = Simulink.Bus()
  BCS_RLWheelRotatedDirection: double, Min=0, Max=1  % RL wheel rotate direction
  BCS_RLWheelRotatedDirectionVD: double, Min=0, Max=1  % RL wheel rotate direction validity
  BCS_RLWheelSpd: double, Min=0, Max=240, Unit="km/h"  % Current wheel speed information of rear left wheel
  BCS_RLWheelSpdVD: double, Min=0, Max=1  % Quality/fault information to current wheel speed of front left wheel,be used for validity of BCS_RLWheelSpd and BCS_RLWheelSpdEdgesSum signal
  BCS_RRWheelRotatedDirection: double, Min=0, Max=1  % RR wheel rotate direction
  BCS_RRWheelRotatedDirectionVD: double, Min=0, Max=1  % RR wheel rotate direction validity
  BCS_RRWheelSpd: double, Min=0, Max=240, Unit="km/h"  % Current wheel speed information of rear right wheel
  BCS_RRWheelSpdVD: double, Min=0, Max=1  % Quality/fault information to current wheel speed of RRont left wheel,be used for validity of BCS_RRWheelSpd and BCS_RRWheelSpdEdgesSum signal
  SCU_7_Checksum: double, Min=0, Max=255
  SCU_7_MsgCounter: double, Min=0, Max=15  % The message counter is a 0-15 counter, increased of one unit on every message transmission

SCU2ADCU_SCU_8 = Simulink.Bus()
  BCS_ActVehLaltrlAccel: double, Min=-21.593, Max=21.593, Unit="m/s^2"  % Actual vehicle lateral acceleration
  BCS_ActVehLaltrlAccelVD: double, Min=0, Max=1  % Quality/fault information to actual vehicle lateral acceleration
  BCS_ActVehLongAccel: double, Min=-21.593, Max=21.593, Unit="m/s^2"  % Actual vehicle longitudinal acceleration
  BCS_ActVehLongAccelVD: double, Min=0, Max=1  % Quality/fault information to actual vehicle longitudinal acceleration
  BCS_VehLaltrlAccelOffset: double, Min=-21.593, Max=21.593, Unit="m/s^2"  % Actual vehicle lateral acceleration offset
  BCS_VehLongAccelOffset: double, Min=-21.593, Max=21.593, Unit="m/s^2"  % Actual vehicle longitudinal acceleration offset
  SCU_8_Checksum: double, Min=0, Max=255
  SCU_8_MsgCounter: double, Min=0, Max=15  % The message counter is a 0-15 counter, increased of one unit on every message transmission

SCU2ADCU_SCU_9 = Simulink.Bus()
  EPB_FailSt: double, Min=0, Max=1  % EPB fail status,to indicate wether EPB can response to external apply  request or not
  EPB_SwitchSt: double, Min=0, Max=3  % EPB switch status
  EPB_SwitchStVD: double, Min=0, Max=1  % EPB switch status validity
  EPB_SysSt: double, Min=0, Max=7  % EPB system status
  SCU_9_Checksum: double, Min=0, Max=255  % Message checksum
  SCU_9_MsgCounter: double, Min=0, Max=15  % Message counter

InputCAN = Simulink.Bus()  % 输入CAN接口
  SCU2ADCU_bus: Bus: SCU2ADCU  % VCU到IDS的输入接口

OutputCAN = Simulink.Bus()  % 输出CAN接口
  ADCU2SCU_bus: Bus: ADCU2SCU  % IDS到VCU的输出接口

GNSS2ADCU = Simulink.Bus()  % GNSS到IDS的输入接口
  GNSSTime: double, Min=0, Unit="s"  % 组合惯导秒数（从本周日0:00:00至当前的秒数，精确到毫秒）
  Heading: double, Min=0, Max=359.99, Unit="°"  % 组合惯导航向角
  Pitch: double, Min=-90, Max=90, Unit="°"  % 组合惯导俯仰角
  Roll: double, Min=-180, Max=180, Unit="°"  % 组合惯导横滚角
  Latitude: double, Min=-90, Max=90, Unit="°"  % 组合惯导纬度
  Longitude: double, Min=-180, Max=180, Unit="°"  % 组合惯导经度
  Altitude: double, Min=-200, Max=8000, Unit="m"  % 组合惯导高度
  GNSSWorkStatus: Enum: GNSS_Status  % 组合惯导工作状态
  AngleSpeedX: double, Min=-360, Max=360, Unit="°/s"  % 组合惯导X角速度
  AngleSpeedY: double, Min=-360, Max=360, Unit="°/s"  % 组合惯导Y角速度
  AngleSpeedZ: double, Min=-360, Max=360, Unit="°/s"  % 组合惯导Z角速度
  AccelerationX: double, Min=-1, Max=1, Unit="g"  % 组合惯导X加速度
  AccelerationY: double, Min=-1, Max=1, Unit="g"  % 组合惯导Y加速度
  AccelerationZ: double, Min=-1, Max=1, Unit="g"  % 组合惯导Z加速度

InputSerial = Simulink.Bus()  % 输入串口
  GNSS2ADCU_bus: Bus: GNSS2ADCU  % GNSS到IDS的输入接口

ADCU_OutputBus = Simulink.Bus()
  OutputCAN_bus: Bus: OutputCAN

SCU2ADCU = Simulink.Bus()  % SCU发送到ADCU的CAN总线
  SCU_1: Bus:SCU2ADCU_SCU_1
  SCU_10: Bus:SCU2ADCU_SCU_10
  SCU_11: Bus:SCU2ADCU_SCU_11
  SCU_12: Bus:SCU2ADCU_SCU_12
  SCU_13: Bus:SCU2ADCU_SCU_13
  SCU_14: Bus:SCU2ADCU_SCU_14
  SCU_15: Bus:SCU2ADCU_SCU_15
  SCU_16: Bus:SCU2ADCU_SCU_16
  SCU_17: Bus:SCU2ADCU_SCU_17
  SCU_18: Bus:SCU2ADCU_SCU_18
  SCU_2: Bus:SCU2ADCU_SCU_2
  SCU_3: Bus:SCU2ADCU_SCU_3
  SCU_4: Bus:SCU2ADCU_SCU_4
  SCU_5: Bus:SCU2ADCU_SCU_5
  SCU_6: Bus:SCU2ADCU_SCU_6
  SCU_7: Bus:SCU2ADCU_SCU_7
  SCU_8: Bus:SCU2ADCU_SCU_8
  SCU_9: Bus:SCU2ADCU_SCU_9

ADCU2SCU = Simulink.Bus()  % ADCU发送到SCU的CAN总线
  ADCU_1: Bus:ADCU2SCU_ADCU_1
  ADCU_2: Bus:ADCU2SCU_ADCU_2
  ADCU_3: Bus:ADCU2SCU_ADCU_3
  aaa: Bus: InputCAN

ADCU_InputBus = Simulink.Bus()
  InputCAN_bus: Bus: InputCAN

CONTROL_CYCLE_TIME = 0.02
SCU_ADCU_CYCLE_TIME = 0.02
ADCU_SCU_CYCLE_TIME = 0.02
steer_angle_test = 3
longitudinal_control_request_test = 0
steer_torque_test = 0
gear_test = 1
lateral_control_request_test = 1

BCS_Info = Simulink.Bus()
  get_ABSActiveSt: uint8, Min=0, Max=1, Unit="-"  % Indication that ABS system currently performs a brake intervention
  get_ABSFaultSt: uint8, Min=0, Max=1, Unit="-"  % ABS system has detected a failure which does no allow a reliable ABS regulation and is therefore switched off
  get_VDCActiveSt: uint8, Min=0, Max=1, Unit="-"  % Indication that VDC system currently performs a brake/engine intervention
  get_VDCFaultSt: uint8, Min=0, Max=1, Unit="-"  % VDC is switched off due to detected failure
  get_VehSpd: double, Min=0, Max=240, Unit="km/h"  % Vehicle speed
  get_VehSpdVD: uint8, Min=0, Max=1, Unit="-"  % Quality/fault information to vehicle speed
  get_FLWheelSpdEdgesSum: uint32, Min=0, Max=4095  % Accumulated sum of rising and falling edges of front left wheel speed sensor output·since IGN ON( the wheel plate have 43 teeth/cycle,the edge is 86)
  get_FLWheelSpdEdgesSumVD: uint8, Min=0, Max=1  % Quality/fault information to current wheel speed edges sum of front left wheel
  get_FRWheelSpdEdgesSum: uint32, Min=0, Max=4095  % Accumulated sum of rising and falling edges of front right wheel speed sensor output·since IGN ON( the wheel plate have 43 teeth/cycle,the edge is 86)
  get_FRWheelSpdEdgesSumVD: uint8, Min=0, Max=1  % Quality/fault information to current wheel speed edges sum of front right wheel
  get_RLWheelSpdEdgesSum: uint32, Min=0, Max=4095  % Accumulated sum of rising and falling edges of rear left wheel speed sensor output·since IGN ON( the wheel plate have 43teeth/cycle,the edge is 86)
  get_RLWheelSpdEdgesSumVD: uint8, Min=0, Max=1  % Quality/fault information to current wheel speed edges sum of rear left wheel
  get_RRWheelSpdEdgesSum: uint32, Min=0, Max=4095  % Accumulated sum of rising and falling edges of  rear right wheel speed sensor output·since IGN ON( the wheel plate have 43 teeth/cycle,the edge is 86)
  get_RRWheelSpdEdgesSumVD: uint8, Min=0, Max=1  % Quality/fault information to current wheel speed edges sum of rear right wheel
  get_YawRate: double, Min=-2.0943, Max=1.9047234375, Unit="rad/s"  % Yaw rate
  get_YawRateOffset: double, Min=-0.13, Max=0.13, Unit="rad/s"  % Yaw rate offset
  get_YawRateSt: uint8, Min=0, Max=1  % Yaw rate status
  get_HDCCtrlSt: uint8, Min=0, Max=3, Unit="-"  % HDC(Hill Descent Control) Control status
  get_HDCErrSt: uint8, Min=0, Max=1, Unit="-"  % HDC error Status
  get_AEBActive: uint8, Min=0, Max=1  % AEB(Automatic Emergency
    % Braking) is active (in deceleration)
  get_AEBAvailable: uint8, Min=0, Max=1  % AEB(Automatic Emergency
    % Braking) is available
  get_CDDActive: uint8, Min=0, Max=1  % CDD(Controlled Deceleration for Driver) is active
  get_CDDAvailable: uint8, Min=0, Max=1  % CDD(Controlled Deceleration for Driver) is available
  get_CDDFail: uint8, Min=0, Max=1  % CDD in failure
  get_MasterCylinderPr: double, Min=0, Max=250, Unit="bar"  % Master cylinder pressure
  get_MasterCylinderPrOffset: double, Min=-15, Max=15, Unit="bar"  % Master cylinder pressure offset
  get_MasterCylinderPrOffsetVD: uint8, Min=0, Max=1, Unit="-"  % Master cylinder pressure offset valid value
  get_MasterCylinderPrVD: uint8, Min=0, Max=1, Unit="-"  % The valid value of BCS_MasterCylinderPr
  get_NoBrakeForce: uint8, Min=0, Max=1  % No brake pressure applied,generally it regards wheel cylinder presure
  get_VehicleStandStillSt: uint8, Min=0, Max=3  % Indicating whether the vehicle is standstill or not;
    % must not be set until standstill is surely reached.
  get_FLWheelRotatedDirection: uint8, Min=0, Max=1  % FL wheel rotate direction
  get_FLWheelRotatedDirectionVD: uint8, Min=0, Max=1  % FL wheel rotate direction validity
  get_FLWheelSpd: double, Min=0, Max=240, Unit="km/h"  % Current wheel speed information of front left wheel
  get_FLWheelSpdVD: uint8, Min=0, Max=1  % Quality/fault information to current wheel speed of front left wheel,be used for validity of BCS_FLWheelSpd and BCS_FLWheelSpdEdgesSum signal
  get_FRWheelRotatedDirection: uint8, Min=0, Max=1  % FR wheel rotate direction
  get_FRWheelRotatedDirectionVD: uint8, Min=0, Max=1  % FR wheel rotate direction validity
  get_FRWheelSpd: double, Min=0, Max=240, Unit="km/h"  % Current wheel speed information of front right wheel
  get_FRWheelSpdVD: uint8, Min=0, Max=1  % Quality/fault information to current wheel speed of front left wheel,be used for validity of BCS_FRWheelSpd and BCS_FRWheelSpdEdgesSum signal
  get_RLWheelRotatedDirection: uint8, Min=0, Max=1  % RL wheel rotate direction
  get_RLWheelRotatedDirectionVD: uint8, Min=0, Max=1  % RL wheel rotate direction validity
  get_RLWheelSpd: double, Min=0, Max=240, Unit="km/h"  % Current wheel speed information of rear left wheel
  get_RLWheelSpdVD: uint8, Min=0, Max=1  % Quality/fault information to current wheel speed of front left wheel,be used for validity of BCS_RLWheelSpd and BCS_RLWheelSpdEdgesSum signal
  get_RRWheelRotatedDirection: uint8, Min=0, Max=1  % RR wheel rotate direction
  get_RRWheelRotatedDirectionVD: uint8, Min=0, Max=1  % RR wheel rotate direction validity
  get_RRWheelSpd: double, Min=0, Max=240, Unit="km/h"  % Current wheel speed information of rear right wheel
  get_RRWheelSpdVD: uint8, Min=0, Max=1  % Quality/fault information to current wheel speed of RRont left wheel,be used for validity of BCS_RRWheelSpd and BCS_RRWheelSpdEdgesSum signal
  get_ActVehLaltrlAccel: double, Min=-21.593, Max=21.593, Unit="m/s^2"  % Actual vehicle lateral acceleration
  get_ActVehLaltrlAccelVD: uint8, Min=0, Max=1  % Quality/fault information to actual vehicle lateral acceleration
  get_ActVehLongAccel: double, Min=-21.593, Max=21.593, Unit="m/s^2"  % Actual vehicle longitudinal acceleration
  get_ActVehLongAccelVD: uint8, Min=0, Max=1  % Quality/fault information to actual vehicle longitudinal acceleration
  get_VehLaltrlAccelOffset: double, Min=-21.593, Max=21.593, Unit="m/s^2"  % Actual vehicle lateral acceleration offset
  get_VehLongAccelOffset: double, Min=-21.593, Max=21.593, Unit="m/s^2"  % Actual vehicle longitudinal acceleration offset

SRS_Info = Simulink.Bus()
  get_DriverSeatBeltSt: uint8, Min=0, Max=3  % To identify whether Driver Seat Belt is buckled
  get_PsngrSeatBeltSt: uint8, Min=0, Max=3  % To identify whether Passenger Seat Belt is buckled

EPS_Info = Simulink.Bus()
  get_SteeringAngle: double, Min=-780, Max=779.9, Unit="deg"  % Steering wheel angle
  get_SteeringAngleSpd: uint32, Min=0, Max=1016, Unit="deg/sec"  % steering wheel angle speed
  get_SteeringAngleSpdVD: uint8, Min=0, Max=1  % Steering wheel angle speed valid value
  get_SteeringAngleVD: uint8, Min=0, Max=1  % Steering wheel angle valid value
  get_StrngWhlTorq: double, Min=-12.5, Max=12.5, Unit="Nm"  % Steering wheel Torque
  get_StrngWhlTorqVD: uint8, Min=0, Max=1  % Steering Wheel Torque valid value
  get_ThermalSt: uint8, Min=0, Max=3  % System Thermal status
  get_WarnLamp: uint8, Min=0, Max=1  % Steering Warning Lamp

AION_ApplicationBus = Simulink.Bus()  % 适配AION车的IDS应用层总线
  set_lateral_control_info: Bus: AION_Lateral_Control_Info
  set_longitudinal_control_info: Bus: AION_Longitudinal_Control_Info  % 纵向控制信息
  set_ADCU_info: Bus: ADCU_Info
  get_BCS_info: Bus: BCS_Info  % 制动系统信号
  get_VCU_info: Bus: VCU_Info
  get_SCU_info: Bus: SCU_Info
  get_EPB_info: Bus: EPB_Info  % 驻车系统信息
  get_SRS_info: Bus: SRS_Info
  get_EPS_info: Bus: EPS_Info
  get_BCM_info: Bus: BCM_Info

SCU_Info = Simulink.Bus()
  get_Checksum1: uint32, Min=0, Max=255, Unit="-"
  get_MsgCounter1: uint32, Min=0, Max=15, Unit="-"  % The MessageCounter is a 0 ~ 15 counter, increased of one unit on every message transmission
  get_Checksum10: uint32, Min=0, Max=255  % Message checksum
  get_MsgCounter10: uint32, Min=0, Max=15  % Check the MessageCounter consistency atleast on every message reception
  get_Checksum11: uint32, Min=0, Max=255
  get_MsgCounter11: uint32, Min=0, Max=15  % Message counter
  get_Checksum12: uint32, Min=0, Max=255  % Message checksum
  get_MsgCounter12: uint32, Min=0, Max=15  % The message counter is a 0-15 counter, increased of one unit on every message transmission
  get_Checksum13: uint32, Min=0, Max=255  % Message checksum
  get_MsgCounter13: uint32, Min=0, Max=15  % The message counter is a 0-15 counter, increased of one unit on every message transmission
  get_EStopSwSt: uint8, Min=0, Max=1  % Emergency switch status
  get_EStopSwStVD: uint8, Min=0, Max=1  % Emergency switch status validity
  get_LatAutoCheckReport: uint32, Min=0, Max=15  % Check report for Lateral control request(MANUAL->AUTO)
  get_LatCtrlMode: Enum: Control_status  % Lateral control mode
  get_LatQuitReport: uint32, Min=0, Max=255  % Lateral control quit report(Auto->Quit).
  get_LngAutoCheckIReport: uint32, Min=0, Max=65535  % Check report for Longitudinal control request(MANUAL->AUTO).
  get_LngCtrlMode: Enum: Control_status  % Longitudinal control mode
  get_LngQuitReport: uint32, Min=0, Max=65535  % Longitudinal control quit report(Auto->Quit).
  get_StrngWhlIntv: uint8, Min=0, Max=1  % Steering wheel intervention
  get_Checksum16: uint32, Min=0, Max=205, Unit="-"  % Message checksum
  get_MsgCounter16: uint32, Min=0, Max=15, Unit="-"  % The MessageCounter is a 0 ~ 15 counter, increased of one unit on every message transmission
  get_Checksum17: uint32, Min=0, Max=255, Unit="-"  % Checksum signal for frame
  get_MsgCounter17: uint32, Min=0, Max=15, Unit="-"  % Message counter signal for frame
  get_Checksum18: uint32, Min=0, Max=255, Unit="-"  % Checksum signal for frame
  get_MsgCounter18: uint32, Min=0, Max=15, Unit="-"  % Message counter signal for frame
  get_Checksum2: uint32, Min=0, Max=255
  get_MsgCounter2: uint32, Min=0, Max=15  % The message counter is a 0-15 counter, increased of one unit on every message transmission
  get_Checksum3: uint32, Min=0, Max=255  % Message checksum
  get_MsgCounter3: uint32, Min=0, Max=15
  get_Checksum4: uint32, Min=0, Max=255, Unit="-"  % Message checksum
  get_MsgCounter4: uint32, Min=0, Max=15, Unit="-"  % Message counter
  get_Checksum5: uint32, Min=0, Max=255, Unit="-"
  get_MsgCounter5: uint32, Min=0, Max=15
  get_Checksum6: uint32, Min=0, Max=255
  get_MsgCounter6: uint32, Min=0, Max=15  % The message counter is a 0-15 counter, increased of one unit on every message transmission
  get_Checksum7: uint32, Min=0, Max=255
  get_MsgCounter7: uint32, Min=0, Max=15  % The message counter is a 0-15 counter, increased of one unit on every message transmission
  get_Checksum8: uint32, Min=0, Max=255
  get_MsgCounter8: uint32, Min=0, Max=15  % The message counter is a 0-15 counter, increased of one unit on every message transmission
  get_Checksum9: uint32, Min=0, Max=255  % Message checksum
  get_MsgCounter9: uint32, Min=0, Max=15  % Message counter

Available_status = enum(DefaultValue="NotAvailable")  % 横纵向控制功能状态
  NotAvailable = 0  % Not_Available
  Available = 1  % Available

Fault_status = enum(DefaultValue="NotFault")
  NotFault = 0  % No Fault
  Fault = 1  % Fault

Open_status = enum(DefaultValue="Closed")
  Closed = 0  % Closed
  Open = 1  % Open

Error_status = enum(DefaultValue="NoError")
  NoError = 0  % No Error
  Error = 1  % Error

Pressed_status = enum(DefaultValue="NotPressed")
  NotPressed = 0  % Not pressed
  Pressed = 1  % Pressed

Ward_status = enum(DefaultValue="Forward")
  Forward = 0  % Forward
  Backward = 1  % Backward

Ready_status = enum(DefaultValue="NotReady")
  NotReady = 0  % Not Ready
  Ready = 1  % Ready

Failure_status = enum(DefaultValue="NoFailure")
  NoFailure = 0  % No Failure
  enum2 = 1  % Failure

Intervention_status = enum(DefaultValue="WithoutIntervention")
  WithoutIntervention = 0  % Without Intervention
  WithIntervention = 1  % With Intervention

Control_request = enum(DefaultValue="Manual")  % 横纵向控制请求指令
  Manual = 0
  Auto = 1
  Reserved = 2
  Reserved1 = 3

Control_status = enum(DefaultValue="ManualStatus")  % 横纵向控制功能状态
  ManualStatus = 0  % Manual
  QuitStatus = 1  % Quit
  AutoStatus = 2  % Auto
  FaultStatus = 3  % Fault

AION_Lateral_Control_Info = Simulink.Bus()  % 纵向控制信息
  set_LatCtrlReq: Enum: Control_request  % lateral_control_request
  set_SteerWhlTorqReq: double  % steer_torque_request
  set_SteerAngReq: double  % steer_angle_request
  set_SteerAngSpdLimt: double  % steer_ang_spd_limit

EPB_Info = Simulink.Bus()
  get_FailSt: Enum: Error_status  % EPB fail status,to indicate wether EPB can response to external apply  request or not
  get_SwitchSt: uint8, Min=0, Max=3  % EPB switch status
  get_SwitchStVD: uint8, Min=0, Max=1  % EPB switch status validity
  get_SysSt: uint8, Min=0, Max=7  % EPB system status

Beam_request = enum(DefaultValue="NoBeamRequest")  % 横纵向控制功能状态
  NoBeamRequest = 0  % No request
  LowBeam = 1  % Low beam request
  HighBeam = 2  % High beam request
  BeamReserved = 3  % Reserved

Enable_request = enum(DefaultValue="Disable")
  Disable = 0  % Disable
  Enable = 1  % Enable

Light_request = enum(DefaultValue="NoLightRequest")
  NoLightRequest = 0  % No request
  TurnLeftLight = 1  % Turn left light
  TurnRightLight = 2  % Turn right light
  EmergencyLight = 3

Active_request = enum(DefaultValue="NotActiveRequest")
  NotActiveRequest = 0  % NotActive
  ActiveRequest = 1

ADCU_Info = Simulink.Bus()  % ADCU发送消息中除了横向和纵向控制之外的消息
  set_Checksum1: uint32, Min=0, Max=255  % Message checksum
  set_MsgCounter1: uint32, Min=0, Max=15  % Message counter of ADCU_1
  set_Checksum2: uint32, Min=0, Max=255  % Message checksum
  set_MsgCounter2: uint32, Min=0, Max=15  % Message counter of ADCU_2
  set_Checksum3: uint32, Min=0, Max=255, Unit="-"  % Message checksum
  set_MsgCounter3: uint32, Min=0, Max=15, Unit="-"  % Message counter of ADCU_3
  set_BeamReq: Enum: Beam_request, Unit="-"  % Low / High beam control request
  set_BodyCtrlReq: Enum: Enable_request, Unit="-"  % Enable vehicle body control
  set_HornRingReq: Enum: Active_request, Unit="-"  % Horn control request
  set_TurnLightReq: Enum: Light_request, Unit="-"  % Turn light control request

ADCU3_SCU_CYCLE_TIME = 0.05

Gear_status = enum(DefaultValue="InvalidGearStatus")
  InvalidGearStatus = 0  % 无效
  DriveGearStatus = 1  % D
  NeutralGearStatus = 2  % N
  ReverseGearStatus = 3  % R
  ParkGearStatus = 4  % P

Gear_request = enum(DefaultValue="NoRequest")  % 档位
  NoRequest = 0  % 无请求
  P = 1  % P档
  R = 2  % R档
  N = 3  % N档
  D = 4  % D档
  Reserved_gear = 5  % 保留
  Reserved1_gear = 6  % 保留
  Reserved2_gear = 7  % 保留

BCM_Info = Simulink.Bus()
  get_CtrlAvailable: Enum: Available_status  % Body control is available
  get_DriverDoorAjarSt: uint8, Min=0, Max=1  % Driver door ajar status
  get_FrontFogLampSt: uint8, Min=0, Max=1  % Front fog lamp status
  get_FrontWiperSt: uint8, Min=0, Max=3  % Front wiper status
  get_HazardLampSt: Enum: Active_status  % Hazard lamp status
  get_HighBeamSt: Enum: Active_status  % High beam status
  get_HornSt: Enum: Active_status  % Horn status
  get_KeySt: uint8, Min=0, Max=3  % Ignition key position status
  get_LeftTurnLampFaultSt: Enum: Fault_status  % Left turn lamp fault status
  get_LeftTurnLampSt: Enum: Active_status  % Left turn lamp status
  get_LowBeamSt: Enum: Active_status  % Low beam status
  get_PsngrDoorAjarSt: uint8, Min=0, Max=1  % Passenger door ajar status
  get_RLDoorAjarSt: uint8, Min=0, Max=1  % Rear left door ajar status
  get_RRDoorAjarSt: uint8, Min=0, Max=1  % Rear right door ajar status
  get_RearFogLampSt: uint8, Min=0, Max=1  % Rear fog lamp status
  get_RightTurnLampFaultSt: Enum: Fault_status  % Right turn lamp fault status
  get_RightTurnLampSt: Enum: Active_status  % Right turn lamp status

Active_status = enum(DefaultValue="NotActiveStatus")  % 横纵向控制功能状态
  NotActiveStatus = 0  % Not_active
  ActiveStatus = 1  % Active

Drive_status = enum(DefaultValue="InvalidDriveStatus")
  InvalidDriveStatus = 0  % 无效
  EcoPlusModeStatus = 1  % ECO+
  EcoModeStatus = 2  % ECO
  NormalModeStatus = 3  % Normal
  DrivingModeStatus = 4  % Driving
  SportModeStatus = 5  % Sport

VCU_Info = Simulink.Bus()
  get_GearLeverIntv: uint8, Min=0, Max=1  % Gear intervention
  get_VehDrvMod: Enum: Drive_status, Unit="-"  % Drive mode for display
  get_VehRdySt: Enum: Ready_status, Unit="-"  % HEV system ready status
  get_VehRng: uint32, Min=0, Max=1000, Unit="km"  % Total range for display
  get_ActRecpTorq: uint32, Min=0, Max=2000, Unit="Nm"  % Current recuperation torque of generator
  get_ActRecpTorqSt: uint8, Min=0, Max=3  % Status of recuperation torque of generator
  get_CrntGearLvl: Enum: Gear_status  % VCU current carry out gear level
  get_CrntGearLvlVD: uint8, Min=0, Max=1  % VCU current carry out gear level valid data
  get_ACCMaxRecpDecel: double, Min=-5, Max=7.75, Unit="m/s2"  % Current maximum recuperation deceleration of generator
  get_ACCMaxRecpDecelVD: uint8, Min=0, Max=1  % VCU_ACCMaxRecpDecel valid validity
  get_ActVehWheelTorq: uint32, Min=0, Max=10000, Unit="Nm"  % Actual effective engine torque on wheel level
  get_LateralAssistBtnInfo: uint8, Min=0, Max=1  % Lateral assist button Information
  get_LateralAssistBtnInfoVD: uint8, Min=0, Max=1  % Lateral assist button Information valid data
  get_ACCButtInfo: uint32, Min=0, Max=255  % ACC Button Information
  get_AccElecECFail: uint8, Min=0, Max=1, Unit="-"  % Indicate the error state of electronic engine control.
  get_GasPedalActPst: double, Min=0, Max=99.96, Unit="%"  % Actual position of gas pedal.
  get_GasPedalActPstVD: uint8, Min=0, Max=1  % Actual position of gas pedal validity.
  get_VehWheelTorqMax: uint32, Min=0, Max=10000, Unit="Nm"  % Actual effective maximum adjustable torque on wheel level
  get_BrkPedalSt: uint8, Min=0, Max=1  % Brake pedal status
  get_BrkPedalStVD: uint8, Min=0, Max=1  % VCU_BrakePedSt valid data
  get_GasPedalVirtualPst: double, Min=0, Max=99.96, Unit="%"  % Virtual position of gas pedal position.
  get_GasPedalVirtualPstVD: uint8, Min=0, Max=1  % Virtual position of gas pedal position validity.

AION_Longitudinal_Control_Info = Simulink.Bus()  % 纵向控制信息
  set_LngCtrlReq: Enum: Control_request  % longitudinal_control_request
  set_AutoTrqWhlReq: double, Min=0, Max=5000  % torque_request,扭矩请求
  set_BrakeReq: double, Min=-16, Max=16  % brake_request
  set_GearLvlReq: Enum: Gear_request  % 目标档位（正整数，无量纲）gear_level_request
  set_GearLvlReqVD: Enum: Validation_status  % gear_level_request_valid

Validation_status = enum(DefaultValue="Invalid")  % 有效性
  Invalid = 0  % 无效
  Valid = 1  % 有效

LatCtrlReq_test = 0
SteerAngReq_test = -16.33929
SteerWhlTorqReq_test = 0
GearLvlReqVD_test = 1
LngCtrlReq_test = 0
BrakeReq_test = -0.5
AutoTrqWhlReq_test = 130
GearLvlReq_test = 1
BeamReq_test = 0
BodyCtrlReq_test = 0
TurnLightReq_test = 0
HornRingReq_test = 0
AION_IDS_Speedgoat = Simulink.ConfigSet(StartTime="0", StopTime="inf", Solver="FixedStepAuto", ProdHWDeviceType="Intel->x86-64 (Linux 64)", SystemTargetFile="slrealtime.tlc", TargetLang="C++")  % Apollo开发套件小车智能驾驶系统配套Speedgoat专用配置。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